# Grasshopper definition 251020_Assignment _1_backup.gh (Grasshopper 1.0.7)
# Copyright: 2020
# plug-ins: LunchBox

# ----
# Attempts/Exploration
# (Generating a Grid)
# Prime Number List
# Points and Lines with
#  Prime Numbers
number_slider = Slider(1000, range=0..1000)
c_script = CSharpScript(digitCount=number_slider)  # -> out, digits; inputs digitCount: Int32; disabled
# ---------- c_script: C# ----------
    List<int> primeNum = new List<int>();

    for(int i = 0; i < digitCount; i++)
    {
      bool prime = PrimeTool.IsPrime(i);
      if (prime)
      {
        primeNum.Add(i);
      }
    }
    digits = primeNum;
# ---------- c_script: C# additional code ----------
  class PrimeTool
  {
    public static bool IsPrime(int candidate)
    {
      // Test whether the parameter is a prime number.
      if ((candidate & 1) == 0)
      {
        if (candidate == 2)
        {
          return true;
        }
        else
        {
          return false;
        }
      }
      // Note:
      // ... This version was changed to test the square.
      // ... Original version tested against the square root.
      // ... Also we exclude 1 at the end.
      for (int i = 3; (i * i) <= candidate; i += 2)
      {
        if ((candidate % i) == 0)
        {
          return false;
        }
      }
      return candidate != 1;
    }
  }
# ---------- end c_script ----------
c_script_2 = CSharpScript(digitCount=number_slider)  # -> out, pNum, allNum, pList, oLine, cLine; inputs digitCount: Int32; disabled
# ---------- c_script_2: C# ----------
    //Making a New List for Prime Numbers
    List<int> primeNum = new List<int>();

    //Using for loop to add Prime Numbers:
    for(int i = 0; i < digitCount; i++)
    {
      bool prime = PrimeTool.IsPrime(i);
      if (prime)
      {
        primeNum.Add(i);
      }
    }

    //Output the List of Prime Numbers
    pNum = primeNum;

    //An empty list of integers:
    List<int> list = new List<int>();

    // Use a for loop to add elements:
    for (int i = 0; i < digitCount; i++)
    {
      list.Add(i);
    }

    allNum = list;

    //Adding a Point for each number
    List<Point3d> plist = new List<Point3d>();

    // Use a for loop to add elements:
    for (int i = 0; i < digitCount; i++)
    {
      Point3d point = new Point3d (i, 0, 0);
      plist.Add(point);

    }
    pList = plist;

    //Making line
    List<Line> nLine = new List<Line>();

    // Use a for loop to add elements:
    for (int i = 0; i < digitCount; i++)
    {
      Line newLine = new Line(i, 0, 0, i + 1, 0, 0);
      nLine.Add(newLine);

    }
    oLine = nLine;

    //Making line based on direction
    List<Line> dirLine = new List<Line>();

    // Use a for loop to add elements:
    for (int i = 0; i < digitCount; i++)
    {
      bool prime = PrimeTool.IsPrime(i);
      if (prime)
      {
        Line newLine1 = new Line(0, i, 0, 0, i + 1, 0);
        dirLine.Add(newLine1);
      }
      else
      {
        Line newLine1 = new Line(0, 0, 0, 0, 0, 0);
        dirLine.Add(newLine1);
      }
    }
    cLine = dirLine;
# ---------- c_script_2: C# additional code ----------
  class PrimeTool
  {
    public static bool IsPrime(int candidate)
    {
      // Test whether the parameter is a prime number.
      if ((candidate & 1) == 0)
      {
        if (candidate == 2)
        {
          return true;
        }
        else
        {
          return false;
        }
      }
      for (int i = 3; (i * i) <= candidate; i += 2)
      {
        if ((candidate % i) == 0)
        {
          return false;
        }
      }
      return candidate != 1;
    }
  }
# ---------- end c_script_2 ----------
# Using the Rotate Method
c_script_3 = CSharpScript(digitCount=number_slider)  # -> out, pNum, npNum, v1Out, v2Out, Line; inputs digitCount: Int32; disabled
# ---------- c_script_3: C# usings ----------
using System.IO;
using System.Linq;
using System.Data;
using System.Drawing;
using System.Reflection;
using System.Windows.Forms;
using System.Xml;
using System.Xml.Linq;
using System.Runtime.InteropServices;
# ---------- c_script_3: C# ----------
    //Making a New List for Prime Numbers
    List<int> primeNum = new List<int>();

    //Making a New List for Non-Prime Numbers
    List<int> nonprimeNum = new List<int>();

    //Using for loop for both Prime and Non-Prime Numbers:
    for(int i = 0; i < digitCount; i++)
    {
      bool prime = PrimeTool.IsPrime(i);
      if (prime)
      {
        primeNum.Add(i);
      }
      else
      {
        nonprimeNum.Add(i);
      }
    }
    //Output the List of Prime Numbers
    pNum = primeNum;
    npNum = nonprimeNum;



    //Making a New List for Vectors for Prime Numbers
    List<Vector3d> vecPrime = new List<Vector3d>();
    //Making a New List for Vectors for Non Prime Numbers
    List<Vector3d> vecNonPrime = new List<Vector3d>();


    //rotate: (Math.Radians(angle), new Vector3d(0, 0, 1));

    //Defining the current Direction(North)
    Vector3d currentDir = new Vector3d(0, 1, 0);

    //Using for loop for changing directions
    for(int i = 0; i < digitCount; i++)
    {
      bool prime = PrimeTool.IsPrime(i);
      if (prime)
      {
        //Rotate Method
        double angle = 90;
        Transform t = new Transform(x);
        var x = 0;
        x = t.Rotation(Math.Radians(angle), new Vector3d(0, 0, 1));
        Vector3d west = new Vector3d(currentDir);
        west.Transform(t);
      }
      else
      {
        vecNonPrime.Add(currentDir);
      }
    }

    v1Out = west;
    v2Out = vecNonPrime;
# ---------- c_script_3: C# additional code ----------
  //class PickDirection
  //{
  // static void Vector3d(Vector3d pickDir)
  //{
  //Making a new list for all possible directions
  //List<Vector3d> vecDirection = new List<Vector3d>();

  //Defining the directions to be added to the list
  //Vector3d vNorth = new Vector3d(0, 1, 0);
  //Vector3d vEast = new Vector3d(1, 0, 0);
  //Vector3d vSouth = new Vector3d(0, -1, 0);
  // Vector3d vWest = new Vector3d(-1, 0, 0);

  //Adding the directions to the list
  //vecDirection.Add(vNorth);
  //vecDirection.Add(vEast);
  //vecDirection.Add(vSouth);
  //vecDirection.Add(vWest);

  //Select a random direction for prime
  //var random = new Random();
  //int v = random.Next(vecDirection.Count);
  //return v;
  //}
  //}


  class PrimeTool
  {
    public static bool IsPrime(int n)
    {
      // Test whether the parameter is a prime number.
      if ((n & 1) == 0)
      {
        if (n == 2)
        {
          return true;
        }
        else
        {
          return false;
        }
      }
      for (int i = 3; (i * i) <= n; i += 2)
      {
        if ((n % i) == 0)
        {
          return false;
        }
      }


      return n != 1;
    }
  }
# ---------- end c_script_3 ----------
data = Data(c_script_2.cLine)  # disabled
panel = Panel(c_script_3.v2Out)  # disabled
panel_2 = Panel(c_script_2.cLine)  # disabled
panel_3 = Panel(c_script.digits)  # disabled

range = Range(Domain=Domain(0, 1), Steps=Slider(9, range=0..10))

# ----
# C# Component 1
c_script_4 = CSharpScript()  # -> out, A
# ---------- c_script_4: C# ----------
    Random rnd = new Random();
    List<Vector3d> vecDirection = new List<Vector3d>();
    int[] index = {0,1};
    int index_for_TranslationVecs = 0;
    //Stores all the translation vectors
    List<Vector3d> TranslationVecs = new List<Vector3d>();

    //Current vector direction
    Vector3d currentDir = new Vector3d(0, 1, 0);
    TranslationVecs.Add(currentDir);

    //Defining the directions to be added to the list
    Vector3d vUp = new Vector3d(0, 0, 1);
    Vector3d vDown = new Vector3d(0, 0, -1);
    vecDirection.Add(vUp);
    vecDirection.Add(vDown);

    for (int i = 0; i < 10000; i++)
    {
      if(IsPrime(i)){
        // Select vector
        Vector3d vecDir = vecDirection[rnd.Next(index.Length)];
        Vector3d newVecDir = Vector3d.CrossProduct(vecDir, currentDir);
        currentDir = newVecDir;
        Vector3d ReltranslationVec = i * newVecDir;
        Vector3d AbsTranslationVec = ReltranslationVec + TranslationVecs[index_for_TranslationVecs];
        TranslationVecs.Add(AbsTranslationVec);
        index_for_TranslationVecs++;
      }
    }


    A = TranslationVecs;
# ---------- c_script_4: C# additional code ----------
  public static bool IsPrime(int n)
  {
    // Test whether the parameter is a prime number.
    if ((n & 1) == 0)
    {
      if (n == 2)
      {
        return true;
      }
      else
      {
        return false;
      }
    }
    for (int i = 3; (i * i) <= n; i += 2)
    {
      if ((n % i) == 0)
      {
        return false;
      }
    }
    return n != 1;
  }
# ---------- end c_script_4 ----------

pt = ConstructPoint(XCoordinate=range, YCoordinate=range, ZCoordinate=0)

pt_2 = Point(c_script_4.A)
# Extracting set of curves using Voronoi
hull = ConvexHull(Points=pt_2, Plane=PlaneXY(0, 0, 0))  # -> Hull, HullZ, Indices
voronoi = Voronoi(Points=pt_2, BruteForceOverride=False)
area = Area(Geometry=voronoi)  # -> Area, Centroid
incurve = PointInCurve(Point=area.Centroid, Curve=hull.Hull)  # -> Relationship, Point
cull = CullPattern(List=voronoi, CullPattern=incurve.Relationship)

c_2 = CSharpScript(enable=Toggle(True), crvList=voronoi)  # -> out, flatten(brepTree); inputs enable: Boolean, crvList: list of Curve
# ---------- c_2: C# usings ----------
using System.IO;
using System.Linq;
using System.Data;
using System.Drawing;
using System.Reflection;
using System.Windows.Forms;
using System.Xml;
using System.Xml.Linq;
using System.Runtime.InteropServices;

using Rhino.DocObjects;
using Rhino.Collections;
using GH_IO;
using GH_IO.Serialization;
# ---------- c_2: C# ----------
    if(!enable)
    {
      Print(" ");
      Print("Enable the Button");
      return;
    }
    crvList = crvList.Where(x => x != null).ToList();

    if(!crvList.Any())
    {
      Print(" ");
      Print("Surface is formed");
      return;
    }

    DataTree<Brep> breps = new DataTree<Brep>();
    MakeBreps(crvList, ref breps);

    //Output
    brepTree = breps;
# ---------- c_2: C# additional code ----------
  public void MakeBreps(List<Curve> crvList, ref DataTree<Brep> breps)
  {
    for (int i = 0; i < crvList.Count;i++)
    {
      Curve c = crvList[i];
      string log;
      if(c.IsValidWithLog(out log) && c.IsPlanar() && c.IsClosed)
      {
        try
        {
          Brep[] arrayB = Brep.CreatePlanarBreps(c);
          breps.AddRange(arrayB, new GH_Path(i));
        }
        catch{Print(" "); Print("Some issue with Method at: {0}", i);}
      }
      else{Print(" "); Print("Invalid/notPlanar/notClosed at: {0} [log: {1}]", i, log);}
    }
  }
# ---------- end c_2 ----------
area_2 = Area(Geometry=c_2.brepTree)  # -> Area, Centroid
bnd = Bounds(Numbers=area_2.Area)
gradient = Gradient(
    LowerLimit=Slider(0, range=0..100),
    UpperLimit="9.8000e+7",
    Parameter=bnd,
    stops=[0: RGB(255, 255, 255), 1: RGB(0, 0, 0)])

preview = CustomPreview(Geometry=c_2.brepTree, Material=ColourSwatch(SwatchColor=RGBA(15, 15, 15, 189)))
vb = VBScript(Surface=c_2.brepTree)  # -> out, Patch; inputs Surface: Brep
# ---------- vb: VB usings ----------
Imports System.IO
Imports System.Linq
Imports System.Data
Imports System.Drawing
Imports System.Reflection
Imports System.Windows.Forms
Imports System.Xml
Imports System.Xml.Linq
Imports Microsoft.VisualBasic
Imports System.Runtime.InteropServices

Imports Rhino.DocObjects
Imports Rhino.Collections
Imports GH_IO
Imports GH_IO.Serialization
# ---------- vb: VB ----------
    Dim edges As List(Of Curve) = GetEdges(Surface)
    If (edges Is Nothing) Then Return

    'Start to iteratively merge neighbour curves that have the lowest break angle.
    'Once we're down to 4 edge-curves we can create a patch.
    Do
      If (edges.Count < 4) Then
        'We don't handle this yet.
        Return
      End If
      If (edges.Count = 4) Then
        Dim p As Brep = Brep.CreateEdgeSurface(edges)
        Dim s As Surface = p.Faces(0).DuplicateSurface()
        s = s.Rebuild(3, 3, 20, 20)
        SmoothSurface(s)
        SmoothSurface(s)
        SmoothSurface(s)
        Patch = s
        Return
      End If

      MergeBestNeighbours(edges)
    Loop
# ---------- vb: VB additional code ----------
  Private Function GetEdges(brep As Brep) As List(Of Curve)
    If (brep Is Nothing) Then Return Nothing
    If (brep.Loops.Count <> 1) Then Return Nothing

    Dim boundary As BrepLoop = brep.Loops(0)
    Dim curve As Curve = boundary.To3dCurve()
    Dim nurbs As NurbsCurve = curve.ToNurbsCurve()

    Return New List(Of Curve)(nurbs.DuplicateSegments())
  End Function

  Private Function MergeBestNeighbours(curves As List(Of Curve)) As Boolean
    Dim iA As Int32 = 0
    Dim iB As Int32 = 1
    Dim minAngle As Double = Double.MaxValue

    For i As Int32 = 0 To curves.Count - 1
      Dim j As Int32 = i + 1
      If (j >= curves.Count) Then j = 0

      Dim localAngle As Double = CurveCurveAngle(curves(i), curves(j))
      If (localAngle < minAngle) Then
        iA = i
        iB = j
        minAngle = localAngle
      End If
    Next

    Dim cC As New PolyCurve()
    cC.Append(curves(iA))
    cC.Append(curves(iB))
    curves.RemoveAt(Math.Max(iA, iB))
    curves.RemoveAt(Math.Min(iA, iB))

    Dim nC As NurbsCurve = cC.Rebuild(50, 3, True)
    curves.Insert(iA, nC)

    Return True
  End Function
  Private Function CurveCurveAngle(A As Curve, B As Curve) As Double
    Dim pA0 As Point3d = A.PointAtStart
    Dim pA1 As Point3d = A.PointAtEnd
    Dim pB0 As Point3d = B.PointAtStart
    Dim pB1 As Point3d = B.PointAtEnd

    Dim d0 As Double = pA1.DistanceTo(pB0)
    Dim d1 As Double = pB1.DistanceTo(pA0)

    Dim tA As Vector3d = A.TangentAtEnd
    Dim tB As Vector3d = B.TangentAtStart
    If (d1 < d0) Then
      tA = B.TangentAtEnd
      tB = A.TangentAtStart
    End If

    Return Vector3d.VectorAngle(tA, tB)
  End Function

  Private Function SmoothSurface(S As NurbsSurface) As Boolean
    For u As Int32 = 1 To s.Points.CountU - 2
      For v As Int32 = 1 To s.Points.CountV - 2
        Dim cp0 As ControlPoint = s.Points.GetControlPoint(u - 1, v)
        Dim cp1 As ControlPoint = s.Points.GetControlPoint(u + 1, v)
        Dim cp2 As ControlPoint = s.Points.GetControlPoint(u, v - 1)
        Dim cp3 As ControlPoint = s.Points.GetControlPoint(u, v + 1)
        Dim pt As Point3d = 0.25 * (cp0.Location + cp1.Location + cp2.Location + cp3.Location)
        s.Points.SetControlPoint(u, v, pt)
      Next
    Next
    Return True
  End Function
# ---------- end vb ----------
iso = IsoCurve(Surface=reparameterize(graft(vb.Patch)), UVPoint=pt)  # -> UIsocurve, VIsocurve
preview_2 = CustomPreview(Geometry=cull, Material=ColourSwatch(SwatchColor=RGB(255, 255, 255)))
panel_4 = Panel(c_2.brepTree)
preview_3 = CustomPreview(Geometry=[iso.UIsocurve, iso.VIsocurve], Material=ColourSwatch(SwatchColor=RGB(150, 150, 150)))
geo = Geometry(cull)
preview_4 = CustomPreview(Geometry=geo, Material=ColourSwatch(SwatchColor=RGB(0, 0, 0)))

# ----
# Calculating the direct radiation values
ladybug = Ladybug_Ladybug()  # -> Vviiiiiiiiiizzz; plug-in component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
path = FilePath("C:\Users\KRKH\OneDrive - Harvard University\Fall 2020\GSD-6338  Introduction to Computational Design\Assignment[1]\IND_DL_New.Delhi-Safdarjung.AP.421820_ISHRAE2014\IND_DL_New.Delhi-Safdarjung.AP.421820_ISHRAE2014.epw")
importepw = Ladybug_ImportEpw(epwFile=path)  # -> readMe, latitude, location, dryBulbTemperature, dewPointTemperature, relativeHumidity, windSpeed, windDirection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; plug-in component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
gencumulativeskymtx = Ladybug_GenCumulativeSkyMtx(epwFile=path, skyDensity=0, useOldRes=True, runIt=Toggle(True))  # -> readMe, cumulativeSkyMtx; plug-in component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
area_3 = Area(Geometry=hull.Hull)  # -> Area, Centroid
strnum = Ladybug_SeparateData(inputList=flatten(importepw.directNormalRadiation))  # -> numbers, strings; plug-in component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

number_slider_2 = Slider(1000, range=0..10000)

# ----
# Identifying the moving "people" (spheres)
number_slider_3 = Slider(9, range=0..100)
c_script_5 = CSharpScript(cells=cull, pathLength=number_slider_3, numPaths=Slider(32, range=0..100))  # -> out, A; inputs cells: list of Polyline, pathLength: Int32, numPaths: Int32
# ---------- c_script_5: C# ----------
    // Notes
    // Possible sources of bugs
    //- the Distinct method is a refernce comparision not a value comparision
    //  Might result in gibberish being spewed out if memory addresses are changed
    //  Cant fix - results in infinite recursion

    // Global tolarance value - 0.1 is probably the highest for which this still works
    double tol = 0.001;


    // Prepwork and starting - clean up the inputs
    List<Line> Exploded_Lines = ExplodeAllLines(cells);
    List<Line> UniqueLines = Exploded_Lines.Distinct().ToList();
    List<Point3d> UniquePoints = GetUniquePoints(UniqueLines, tol);
    UniquePoints = Point3d.CullDuplicates(UniquePoints, tol).ToList();
    // Create the graph structure
    List<Node> Graph = Node.ConvertToGraph(UniquePoints, UniqueLines, tol);


    Tuple<int, int> randomPoints = Gen_two_random_points(0, Graph.Count);

    //Declare an empty List - this shall store the path
    var rand = new Random();
    List<Polyline> paths_List = new List<Polyline>();
    for (int paths = 0; paths < numPaths; paths++)
    {
      List<Node> path = new List<Node>();


      int current_index = rand.Next(0, Graph.Count);

      for (int n = 0; n < pathLength; n++)
      {
        path.Add(Graph[current_index]);
        List<int> verts_under_consideration = Graph[current_index].Edges;
        current_index = verts_under_consideration[rand.Next(0, verts_under_consideration.Count)];
      }

      List<Point3d> pointsListPL = new List<Point3d>();

      foreach (Node node in path)
      {
        pointsListPL.Add(node.ReferencePoint);
      }
      Polyline pl = new Polyline(pointsListPL);
      paths_List.Add(pl);
    }
    A = paths_List;
    //THIS DOSENT FUCKING WORKKKK

    //int startIndex = 1;
    //int endIndex = 72;
    // actual pathfinding

    /*
    //Declare an empty List - this shall store the path
    List<Node> path = new List<Node>();
    //Queue the first point - this is where the search starts
    int currentIndex = startIndex;

    // while(currentIndex != endIndex)
    for (int something = 0; something < 15; something++)
    {
    // Declare all this otherwise the fucking thing recurses
    path.Add(Graph[currentIndex]);
    Graph[currentIndex].Colour = 1;

    // these are the possible points that we can move too
    List<int> verts_under_consideration = Graph[currentIndex].Edges;

    double MinDistance = double.PositiveInfinity;
    int nextVert = -1;

    // loop through and find the best vertex to move too
    foreach (int vertex in verts_under_consideration)
    {
    double distance = DistSquared(Graph[vertex].ReferencePoint, Graph[currentIndex].ReferencePoint);
    int nodeColour = Graph[vertex].Colour;
    if(distance < MinDistance && Graph[vertex].Colour == 0){
    nextVert = vertex;
    MinDistance = distance;
    }
    Graph[vertex].Colour = 1;
    }
    try{
    currentIndex = nextVert;
    }
    catch(Exception e){
    currentIndex = endIndex;
    break;
    }
    }

    path.Add(Graph[endIndex]);

    //these are all the testing bits

    List<Point3d> OutList = new List<Point3d>();

    foreach (Node node in path)
    {
    OutList.Add(node.ReferencePoint);
    }
    A = OutList;
    B = Graph[startIndex].ReferencePoint;
    D = UniquePoints;
    C = Graph[startIndex].Edges;
    */
# ---------- c_script_5: C# additional code ----------
  /// <summary>
  /// Tests the points incidence - if they are ore arent within a certain distance
  /// </summary>
  /// <param name="A">The First Point</param>
  /// <param name="B">The Second Point</param>
  /// <param name="tol">The distance tolerance value</param>
  /// <returns>Returns a boolean value</returns>
  public static bool TestIncidence(Point3d A, Point3d B, double tol){
    return (Math.Abs(A.X - B.X) <= tol && Math.Abs(A.Y - B.Y) <= tol && Math.Abs(A.Z - B.Z) <= tol);
  }

  /// <summary>
  /// This Explodes all the lines and returns a list of them
  /// </summary>
  /// <param name="cells">All the closed cells that have to be exploded</param>
  /// <returns>List of exploded lines</returns>
  public static List<Line> ExplodeAllLines(List<Polyline> cells){
    //First declarations and stuff
    List<Line> FinalLines = new List<Line>();

    // Go through the entire list and remove the duplicates
    foreach (Polyline cell in cells){
      //Loop through each cell and then get all the lines that the cell
      //Explode each cell
      for (int i = 0; i < cell.Count - 1; i++){
        Line ln = new Line(cell[i], cell[i + 1]);
        FinalLines.Add(ln);
      }
      Line ln_last = new Line(cell[cell.Count - 1], cell[0]);
      FinalLines.Add(ln_last);
    }
    return FinalLines;
  }

  /// <summary>
  /// Tests for line incidence
  /// </summary>
  /// <param name="line1">Line 1</param>
  /// <param name="line2">Line 2</param>
  /// <returns>Returns if true or not</returns>
  public static bool TestLineIncidence(Line line1, Line line2, double tol){
    bool A = false;
    if(TestIncidence(line1.From, line2.From, tol) || TestIncidence(line1.From, line2.To, tol)){
      if(TestIncidence(line1.To, line2.From, tol) || TestIncidence(line1.To, line2.To, tol)){
        A = true;
      }
    }
    return A;
  }

  /// <summary>
  /// Retuns all the unique end points in a list of lines
  /// </summary>
  /// <param name="lines">The list of lines to get vertices from</param>
  /// <returns>A list of lines</returns>
  public static List<Point3d> GetUniquePoints(List<Line> lines, double tol){
    List<Point3d> Points = new List<Point3d>();
    foreach(Line line in lines){
      Points.Add(line.From);
      Points.Add(line.To);
    }
    return Points.Distinct().ToList();
  }

  /// <summary>
  /// This tests if a point is incident to the endpoint of some line
  /// </summary>
  /// <param name="point">The point to be tested</param>
  /// <param name="line">The line to be tested</param>
  /// <param name="tol">Tolerance value</param>
  /// <returns>bool</returns>
  public static bool TestPointLineIncidence(Point3d point, Line line, double tol){
    return (TestIncidence(line.From, point, tol) || TestIncidence(line.To, point, tol));
  }


  /// <summary>
  /// Returns the index of a point within a certain tolerance
  /// </summary>
  /// <param name="SearchList">List of unique points to search from</param>
  /// <param name="searchPoint">The point to search</param>
  /// <param name="tol">Tolerance to search for</param>
  /// <returns>Index of the point that we found</returns>
  public static int ReturnPointIndex(List<Point3d> SearchList, Point3d searchPoint, double tol){
    int index = -1;

    for (int i = 0; i < SearchList.Count; i++){
      if(TestIncidence(SearchList[i], searchPoint, tol)){
        index = i;
      }
    }

    return index;
  }

  /// <summary>
  /// Calculates the squared distance
  /// </summary>
  /// <param name="A">Point A</param>
  /// <param name="B">Point B</param>
  /// <returns>Double Distance Squared</returns>
  public static double DistSquared(Point3d A, Point3d B){
    return(((B.X - A.X) * (B.X - A.X)) + ((B.Y - A.Y) * (B.Y - A.Y)) + ((B.Z - A.Z) * (B.Z - A.Z)));
  }

  public static Tuple<int, int> Gen_two_random_points(int lower_bound, int upper_bound){
    var rand = new Random();
    int int1 = rand.Next(lower_bound, upper_bound);
    int int2 = rand.Next(lower_bound, upper_bound);
    while(int1 == int2){
      int2 = rand.Next(lower_bound, upper_bound);
    }
    return Tuple.Create(int1, int2);
  }

  /// <summary>
  /// This class store the node equivalent of a graph
  /// </summary>
  class Node{
    public int Vertex;
    public List<int> Edges;
    public Point3d ReferencePoint;
    public int Colour = 0;

    public Node(int vertex, List<int> edges, Point3d referencePoint){
      Vertex = vertex;
      Edges = edges;
      ReferencePoint = referencePoint;
    }


    /// <summary>
    /// This is the bit that actually understands and returns the adjacencies
    /// </summary>
    /// <param name="UniquePoints">List of unique points</param>
    /// <param name="UniqueLines">List if Unique lines</param>
    /// <param name="tol">Tolerance value of selecting a point line incidence</param>
    /// <returns>A list of nodes that contain the adjacency stuff</returns>
    public static List<Node> ConvertToGraph(List<Point3d> UniquePoints, List<Line> UniqueLines, double tol){
      List<Node> Graph = new List<Node>();

      for (int i = 0; i < UniquePoints.Count; i++){
        List<Point3d> AdjacencyPoints = new List<Point3d>();
        List<int> AdjacencyIndices = new List<int>();

        foreach (Line line in UniqueLines){
          if(TestPointLineIncidence(UniquePoints[i], line, tol)){
            if(TestIncidence(line.From, UniquePoints[i], tol)){
              AdjacencyPoints.Add(line.To);
            }
            if(TestIncidence(line.To, UniquePoints[i], tol)){
              AdjacencyPoints.Add(line.From);
            }
          }
        }
        // For each ends here

        AdjacencyPoints = Point3d.CullDuplicates(AdjacencyPoints, tol).ToList();
        for (int j = 0; j < AdjacencyPoints.Count; j++)
        {
          if(TestIncidence(AdjacencyPoints[j], UniquePoints[i], tol) != true){
            AdjacencyIndices.Add(ReturnPointIndex(UniquePoints, AdjacencyPoints[j], tol));
          }
        }

        AdjacencyIndices = AdjacencyIndices.Distinct().ToList();
        Node node = new Node(i, AdjacencyIndices, UniquePoints[i]);
        Graph.Add(node);
      }
      return Graph;
    }
  }
# ---------- end c_script_5 ----------
data_2 = Data(c_script_5.A)
eval = EvaluateCurve(Curve=reparameterize(data_2), Parameter=Slider(0.139, range=0..1))  # -> Point, Tangent, Angle
sph = Sphere(Base=eval.Point, Radius=number_slider_2)

offset = OffsetCurve(Curve=data_2, Distance=Slider(1000, range=0..1000), Plane=PlaneXY(0, 0, 0), Corners=1)
pt_3 = Point(eval.Point)
preview_5 = CustomPreview(Geometry=[data_2, offset], Material=ColourSwatch(SwatchColor=RGB(64, 64, 64)))
Z = UnitZ(Factor=number_slider_2)
move = Move(Geometry=sph, Motion=Z)  # -> Geometry, Transform
number_slider_4 = Slider(3, range=0..10)
preview_6 = CustomPreview(Geometry=move.Geometry, Material=ColourSwatch(SwatchColor=RGB(255, 0, 0)))
analysisperiod = Ladybug_AnalysisPeriod(
    fromMonth=Slider(6, range=0..100),
    fromDay=Slider(1, range=0..1),
    fromHour=Slider(6, range=0..10),
    toMonth=Slider(7, range=0..100),
    toDay=Slider(30, range=0..30),
    toHour=Slider(22, range=0..100))  # -> readMe, analysisPeriod; plug-in component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
Z_2 = UnitZ(Factor=Slider(-132235, range=-1000000..1000000))

# ----
# Gives list of centroids within influence radius (using C#)
# Gives list of centroids within influence radius (using Grasshopper)
influence_radius = Slider(70.45, range=0..200)  # disabled
area_4 = Area(Geometry=geo)  # -> Area, Centroid; disabled
c_script_6 = CSharpScript(Centroids=area_4.Centroid, influenceRad=influence_radius)  # -> out, Dist, InRadius, box; inputs Centroids: list of Vector3d, influenceRad: Double, basePlane: list of Plane; disabled
# ---------- c_script_6: C# ----------
    // Gives out a list of centroids(vectors) within influence radius
    // Gives out the list of distances between the central point and the grid points

    // TO BE ADDED
    // 1. Input of changing point from Indrajeet.
    // 2. Extrusion if within influence radius from Kritika.
    // 2a. Surface creation from various voronoi curves.
    // 2b. bRep Mesh for extrusion on that surface.
    // 2c. Logic for extrusion based on Solar radiation.


    List<double> distVecs = new List<double>();                      // List for distance between vectors
    List<Vector3d> vecInRadius = new List<Vector3d>();               // list for vectors inside InfluenceRadius
    List<Plane> planeInRadius = new List<Plane>();                   // Was figuring out use of this
    double distance;

    // Central point - subject to change based on Indrajeet's code
    Vector3d A = Centroids[0];                                       // current central point is the first point


    // adding all vectors within influence radius to vecInRadius
    for( int i = 1; i < Centroids.Count; i++)
    {

      Vector3d B = Centroids[i];

      // pythagorean theorem - calculating distance between our point and each vector
      distance = Math.Sqrt(Math.Pow((A.X - B.X), 2) + Math.Pow((A.Y - B.Y), 2) + Math.Pow((A.Z - B.Z), 2));

      // adding all distances to a list
      distVecs.Add(distance);

      // adding vectors within influence radius to list
      if (distance < influenceRad)
      {
        vecInRadius.Add(B);
      }

    }





    // IGNORE
    // create a plane for each vector in vecInRadius
    // height influenced by distVecs  -- only for trial

    // box geometry at each base plane ---
    /*

    foreach (Vector3d v in vecInRadius)     // harcoded trial - INCOMPLETE
    {
    Interval iX = new Interval(-0.5, 0.5);
    Interval iY = new Interval(-0.5, 0.5);
    Interval iZ = new Interval(0, 0.25);
    Box b = new Box(basePlane, iX, iY, iZ);   // error

    }
    box = b;                                    // out of scope error
    */
    Dist = distVecs;
    InRadius = vecInRadius;
# ---------- end c_script_6 ----------
geo_2 = Geometry(c_script_6.InRadius)  # disabled

# ----
# Making surfaces and randomly diving them
toggle = BooleanToggle(True)

# ----
# C# Component 2
c_2_2 = CSharpScript(enable=toggle, crvList=geo)  # -> out, brepTree; inputs enable: Boolean, crvList: list of Curve; same code as c_2

srf = Surface(flatten(c_2_2.brepTree))

# ----
# Surface gradient color
number_slider_5 = Slider(12, range=0..100)
jitter = Jitter(List=srf, Jitter=1, Seed=number_slider_5)  # -> Values, Indices
panel_5 = Panel("""0
1""")
partition = PartitionList(List=jitter.Values, Size=panel_5)
cluster = Cluster(T=partition)

# ----
# Selecting the larger areas for extrusion -
# they are the "Building Blocks"
# The smaller areas are the "Green Pockets"
srf_2 = Surface(srf)
area_5 = Area(Geometry=srf_2)  # -> Area, Centroid
larger = LargerThan(FirstNumber=area_5.Area, SecondNumber="7.5000e+6")  # -> LargerThan, OrEqualTo
cull_2 = CullPattern(List=srf_2, CullPattern=larger.LargerThan)
srf_3 = Surface(flatten(cull_2))

# ----
# Preview this for some
# rainbow fun!
preview_7 = CustomPreview(Geometry=partition, Shader=cluster)

# ----
# Randomly diving the subsurface into two list
number_slider_6 = Slider(25, range=0..100)
randomsplit = RandomSplitList(MasterList=flatten(srf_3), Seed=number_slider_6, Split=0.5)  # -> ListA, ListB
srf_4 = Surface(randomsplit.ListA)
srf_5 = Surface(randomsplit.ListB)

# ----
# Subdividing the larger surface
# Credits: David Rutten
vb_2 = VBScript(Surface=srf_4)  # -> out, Patch; inputs Surface: Brep; same code as vb
range_2 = Range(Domain=Domain(0, 1), Steps=number_slider_4)
range_3 = Range(Domain=Domain(0, 1), Steps=number_slider_4)
vb_3 = VBScript(Surface=srf_5)  # -> out, Patch; inputs Surface: Brep; same code as vb
pt_4 = ConstructPoint(XCoordinate=range_3, YCoordinate=range_3, ZCoordinate=0)
pt_5 = ConstructPoint(XCoordinate=range_2, YCoordinate=range_2, ZCoordinate=0)
iso_2 = IsoCurve(Surface=reparameterize(graft(vb_2.Patch)), UVPoint=pt_5)  # -> UIsocurve, VIsocurve
iso_3 = IsoCurve(Surface=reparameterize(graft(vb_3.Patch)), UVPoint=pt_4)  # -> UIsocurve, VIsocurve
preview_8 = CustomPreview(Geometry=[iso_2.UIsocurve, iso_2.VIsocurve], Material=ColourSwatch(SwatchColor=RGB(255, 255, 255)))

preview_9 = CustomPreview(Geometry=[iso_3.UIsocurve, iso_3.VIsocurve], Material=ColourSwatch(SwatchColor=RGB(242, 242, 242)))

# ----
# Extruding the Context randomly
merge = Merge(Data1=iso_2.UIsocurve, Data2=iso_2.VIsocurve)  # -> flatten(Result)
srfsplit = SurfaceSplit(Surface=srf_4, Curves=merge)
srf_6 = Surface(flatten(srfsplit))
lng = ListLength(List=srf_6)
dom = ConstructDomain(DomainStart=Slider(500, range=0..10000), DomainEnd=Slider(6725, range=0..100000))
random = Random(Range=dom, Number=lng, Seed=Slider(200, range=0..1000))
Z_3 = UnitZ(Factor=random)
extr = Extrude(Base=srf_6, Direction=Z_3)
preview_10 = CustomPreview(Geometry=extr, Material=ColourSwatch(SwatchColor=RGBA(219, 219, 219, 215)))

facade_geometry = Geometry([<brep referenced from the Rhino model> x4])  # disabled
contextbuildings = Geometry(extr)  # disabled
roof_geometry = Geometry(<brep referenced from the Rhino model>)  # disabled

# ----
# A higher number here
# is a better-oriented building
# Subtract Helpful
# from Harmful
# Visualize Solar Benefit
swatch = ColourSwatch(SwatchColor=RGB(255, 0, 0))  # disabled
swatch_2 = ColourSwatch(SwatchColor=RGB(255, 255, 255))  # disabled
sunpath = Ladybug_SunPath(
    location=importepw.location,
    hour=12,
    day=Slider(6, range=0..10),
    month=12,
    timeStep=1,
    analysisPeriod=analysisperiod.analysisPeriod,
    centerPt=area_3.Centroid,
    sunPathScale=Slider(0.9, range=0..1),
    dailyOrAnnualSunPath=True)  # -> sunVectors, sunAltitudes, sunAzimuths, port, sunSpheresMesh, sunPathCrvs, compassCrvs, altitudeCrvs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; plug-in component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
legendpar = Ladybug_LegendParameters(customColors=flatten([swatch_2, swatch]))  # -> legendPar; disabled; plug-in component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
selectskymtx = Ladybug_selectSkyMtx(
    cumulativeSkyMtx=gencumulativeskymtx.cumulativeSkyMtx,
    HOY=sunpath.sunPositionsHOY,
    removeDiffuse=False,
    removeDirect=False)  # -> readMe, selectedSkyMtx; disabled; plug-in component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
distance_from_base = Panel("0.01")  # disabled
grid_size = Panel("5")  # disabled
toggle_2 = BooleanToggle(False)  # disabled
radiationanalysis = Ladybug_RadiationAnalysis(
    geometry=flatten(facade_geometry),
    context=flatten([contextbuildings, roof_geometry]),
    gridSize=grid_size,
    disFromBase=distance_from_base,
    selectedSkyMtx=flatten(selectskymtx.selectedSkyMtx),
    legendPar=flatten(legendpar),
    parallel=toggle_2,
    runIt=toggle_2)  # -> readMe, contextMesh, analysisMesh, testPts, testVec, port, radiationResult, radiationMesh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; disabled; plug-in component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
subtraction = Subtraction(B=radiationanalysis.radiationResult)  # disabled
wh2btu = Ladybug_Whm2BTUft(Wh_m2=subtraction)  # -> BTU_ft2; disabled; plug-in component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
ma = MassAddition(Input=wh2btu)  # -> Result, PartialResults; disabled
int = Integer(ma.Result)  # disabled
net_solar_benefit = Panel(int)  # disabled

panel_6 = Panel(sunpath.sunPositions)  # disabled
panel_7 = Panel(sunpath.altitudeCrvs)  # disabled
mesh = Mesh(sunpath.sunSpheresMesh)
line = LineSDL(Start=sunpath.sunPositions, Direction=Vector(0, 0, 1), Length=Slider(121273, range=0..1000000))
preview_11 = CustomPreview(Geometry=mesh, Material=ColourSwatch(SwatchColor=RGB(255, 255, 255)))
move_2 = Move(Geometry=line, Motion=Z_2)  # -> Geometry, Transform
debrep = DeconstructBrep(Brep=extr)  # -> Faces, Edges, Vertices
loft = Loft(Curves=move_2.Geometry, Options={Adjust=False, Closed=False, LoftEnds=0, LoftSimp=0, LoftType=0, Rebuild=10, Refit=0.01})
preview_12 = CustomPreview(Geometry=move_2.Geometry, Material=ColourSwatch(SwatchColor=RGB(255, 250, 250)))
preview_13 = CustomPreview(Geometry=debrep.Edges, Material=ColourSwatch(SwatchColor=RGB(110, 110, 110)))
preview_14 = CustomPreview(Geometry=loft, Material=ColourSwatch(SwatchColor=RGB(46, 45, 45)))

swatch_3 = ColourSwatch(SwatchColor=RGB(255, 0, 0))  # disabled
swatch_4 = ColourSwatch(SwatchColor=RGB(0, 201, 17))  # disabled
swatch_5 = ColourSwatch(SwatchColor=RGB(255, 255, 255))  # disabled
mesh_2 = Mesh(radiationanalysis.radiationMesh)  # disabled
panel_8 = Panel("-50")  # disabled
panel_9 = Panel("50")  # disabled
legendpar_2 = Ladybug_LegendParameters(lowBound=panel_8, highBound=panel_9, customColors=flatten([swatch_3, swatch_5, swatch_4]))  # -> legendPar; disabled; plug-in component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
panel_10 = Panel("Solar Radiation Benefit")  # disabled
panel_11 = Panel("kBTU/ft2")  # disabled
recolormesh = Ladybug_RecolorMesh(analysisResult=wh2btu, inputMesh=mesh_2, legendPar=legendpar_2, analysisTitle=panel_10, legendTitle=panel_11)  # -> readMe, newMesh, newLegend, legendBasePt, meshColors, legendColors; disabled; plug-in component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

# ----
# Extruding the heights based on radiation
area_6 = Area(Geometry=srf_5)  # -> Area, Centroid
smaller = SmallerThan(FirstNumber=area_6.Area, SecondNumber="7.500e+7")  # -> SmallerThan, OrEqualTo
cull_3 = CullPattern(List=srf_5, CullPattern=smaller.SmallerThan)
merge_2 = Merge(Data1=iso_3.UIsocurve, Data2=iso_3.VIsocurve)  # -> flatten(Result)
srf_7 = Surface(flatten(cull_3))
srfsplit_2 = SurfaceSplit(Surface=srf_7, Curves=merge_2)
srf_8 = Surface(flatten(srfsplit_2))
equals = Equality(FirstNumber=strnum.numbers, SecondNumber="0")  # -> Equality, Inequality
lng_2 = ListLength(List=srf_8)
cull_4 = CullPattern(List=strnum.numbers, CullPattern=equals.Inequality)
bnd_2 = Bounds(Numbers=cull_4)
dom_2 = ConstructDomain(DomainStart=0, DomainEnd=bnd_2)
random_2 = Random(Range=dom_2, Number=lng_2, Seed=Slider(200, range=0..1000))
multiplication = Multiplication(A=random_2, B=Slider(8, range=2..15))
Z_4 = UnitZ(Factor=multiplication)

area_7 = Area(Geometry=srf_8)  # -> Area, Centroid
cir = Circle(Plane=eval.Point, Radius=Slider(25000, range=0..100000))
incurve_2 = PointInCurve(Point=area_7.Centroid, Curve=cir)  # -> Relationship, Point
cull_5 = CullPattern(List=srf_8, CullPattern=incurve_2.Relationship)

extr_2 = Extrude(Base=cull_5, Direction=Z_4)
preview_15 = CustomPreview(Geometry=extr_2, Material=ColourSwatch(SwatchColor=RGBA(189, 157, 157, 173)))

debrep_2 = DeconstructBrep(Brep=extr_2)  # -> Faces, Edges, Vertices
preview_16 = CustomPreview(Geometry=debrep_2.Edges, Material=ColourSwatch(SwatchColor=RGB(184, 118, 118)))

# ==== cluster Cluster
T = ClusterInput()
tstat = TreeStatistics(Tree=T)  # -> Paths, Length, Count
range = Range(Domain=Domain(0, 0.85), Steps=expr("x-1", tstat.Count))
hsl = ColourHSL(Alpha=1, Hue=range, Saturation=1, Luminance=0.5)
graft = GraftTree(Tree=hsl, IncludeEmptyLists=True, IncludeNullItems=True)
T_2 = ClusterOutput(graft)
